# Grasshopper definition RozvanyCompute.gh (Grasshopper 1.0.7)
# plug-ins: Kangaroo2 Components

int = Integer("-1")
# Number of free edges
panel = Panel("-1")
int_2 = Integer(panel)

grid_size = Slider(0.7, range=0..1.2)
X = Slider(11, range=5..20)
Y = Slider(10, range=5..20)

spacing = GetNumber(grid_size, AtLeast=1, AtMost=2147483647, Maximum=1.797693135e+308, Minimum=-1.797693135e+308)
x_dim = GetNumber(X, AtLeast=1, AtMost=2147483647, Maximum=1.797693135e+308, Minimum=-1.797693135e+308)
y_dim = GetNumber(Y, AtLeast=1, AtMost=2147483647, Maximum=1.797693135e+308, Minimum=-1.797693135e+308)
bottomfix = GetInteger(Slider(-1, range=-1..1), AtLeast=1, AtMost=2147483647, Maximum=2147483647, Minimum=-2147483648)
topfix = GetInteger(Slider(1, range=-1..1), AtLeast=1, AtMost=2147483647, Maximum=2147483647, Minimum=-2147483648)
rightfix = GetInteger(Slider(-1, range=-1..1), AtLeast=1, AtMost=2147483647, Maximum=2147483647, Minimum=-2147483648)
leftfix = GetInteger(Slider(-1, range=-1..1), AtLeast=1, AtMost=2147483647, Maximum=2147483647, Minimum=-2147483648)
merge = Merge(Data1=bottomfix, Data2=rightfix, Data3=topfix, Data4=leftfix)

# ----
# Boundary Shape
X_2 = UnitX(Factor=x_dim)
Y_2 = UnitY(Factor=y_dim)
vec = VectorXYZ(XComponent=X_2, YComponent=Y_2, ZComponent=0)  # -> Vector, Length
int_3 = Integer(merge)
pt = ConstructPoint(XCoordinate=0, YCoordinate=0, ZCoordinate=0)
move = Move(Geometry=pt, Motion=X_2)  # -> Geometry, Transform
move_2 = Move(Geometry=pt, Motion=Y_2)  # -> Geometry, Transform
move_3 = Move(Geometry=pt, Motion=vec.Vector)  # -> Geometry, Transform
pline = PolyLine(Vertices=[pt, move.Geometry, move_3.Geometry, move_2.Geometry], Closed=invert(False))
area = Area(Geometry=pline)  # -> Area, Centroid
pdecon = Deconstruct(Point=area.Centroid)  # -> XComponent, YComponent, ZComponent
vec_2 = VectorXYZ(XComponent=expr("x*1.5", pdecon.XComponent), YComponent=pdecon.YComponent, ZComponent=pdecon.ZComponent)  # -> Vector, Length
neg = Negative(Value=vec_2.Vector)
move_4 = Move(Geometry=pline, Motion=neg)  # -> Geometry, Transform

# ----
# Check if free edges are next to each other
mindex = MemberIndex(Set=int_3, Member=int)  # -> Index, Count
item = ListItem(List=reverse(mindex.Index), Index=0, Wrap=True)
item_2 = ListItem(List=int_3, Index=item, Wrap=True)  # -> Item1, Item, Item1_2
addition = Addition(A=item_2.Item1, B=item_2.Item)
addition_2 = Addition(A=item_2.Item, B=item_2.Item1_2)
sort = SortList(Keys=[addition, addition_2])  # -> Keys, ValuesA
mindex_2 = MemberIndex(Set=int_3, Member=int_2)  # -> Index, Count
# Sum
ma = MassAddition(Input=int_3)  # -> Result, PartialResults
item_3 = ListItem(List=sort.Keys, Index=0, Wrap=True)
expression = Expression(
    x=mindex_2.Count,
    y=ma.Result,
    z=item_3,
    Expression="if((x=2) and (y=-2) and (z≠-2), 0, if((x=2) and (y=-1) and (z≠-2),1,if((x=2) and (y=0) and (z≠-2), 2, if((x=3) and (y=-2),3,if((x=2) and (y=-2) and (z=-2),4,if((x=2) and (y=-1) and (z=-2),5,if((x=2) and (y=0) and (z=-2),6,7)))))))")
explode = Explode(Curve=move_4.Geometry, Recursive=True)  # -> Segments, Vertices

# ---- group: Case 0: Fr,P,Fr,P
int_4 = Integer("0")
mindex_3 = MemberIndex(Set=int_3, Member=int_4)  # -> Index, Count
item_4 = ListItem(List=explode.Segments, Index=mindex_3.Index, Wrap=True)
divdist = DivideDistance(Curve=item_4, Distance=spacing)  # -> Points, Tangents, Parameters
cull_i = CullIndex(List=divdist.Points, Indices=0, Wrap=True)
avr = Average(Input=cull_i)  # -> simplify(ArithmeticMean)
midpt = CurveMiddle(Curve=item_4)
vec2pt = Vector2Pt(PointA=avr, PointB=graft(midpt), Unitize=False)  # -> Vector, Length
move_5 = Move(Geometry=cull_i, Motion=vec2pt.Vector)  # -> Geometry, Transform
bang = ExplodeTree(Data=move_5.Geometry)  # -> _0000, reverse(Branch1)
ln = Line(StartPoint=bang._0000, EndPoint=bang.Branch1)
entwine = Entwine(Branch00=ln, FlattenInputs=True)

# ----
int_5 = Integer(merge)
int_6 = Integer(Slider(-1, range=-2..1))
mindex_4 = MemberIndex(Set=int_5, Member=int_6)  # -> Index, Count
replace = ReplaceItems(List=merge, Item=-5, Indices=mindex_4.Index, Wrap=False)
shift = ShiftList(List=replace, Shift=1, Wrap=True)
expression_2 = Expression(x=replace, y=shift, z=replace, Expression="if((x=-5) and (y=-5), z-5, z)")
shift_2 = ShiftList(List=expression_2, Shift=1, Wrap=True)
subtraction = Subtraction(A=expression_2, B=shift_2)
shift_3 = ShiftList(List=subtraction, Shift=-1, Wrap=True)
expression_3 = Expression(x=shift_3, Expression="if(x=0, 0, if(x=1, 1, if(x=-1, 2, 3)))")

cull_i_2 = CullIndex(List=explode.Vertices, Indices=-1, Wrap=True)
int_7 = Integer(merge)
int_8 = Integer(merge)
int_9 = Integer(merge)

explode_2 = Explode(Curve=move_4.Geometry, Recursive=True)  # -> Segments, Vertices
cull_i_3 = CullIndex(List=explode_2.Vertices, Indices=-1, Wrap=True)
shift_4 = ShiftList(List=explode_2.Segments, Shift=1, Wrap=True)
vec_3 = Vector(shift_4)
vec_4 = Vector(explode_2.Segments)
angle = Angle(VectorA=vec_4, VectorB=vec_3)  # -> Angle, Reflex
expression_4 = Expression(Expression="pi/2 - atan(sqrt(2))")
expression_5 = Expression(Expression="atan(sqrt(2))")
Z = UnitZ(Factor=1)
Z_2 = UnitZ(Factor=1)
Z_3 = UnitZ(Factor=1)
vrot = Rotate(Vector=vec_4, Axis=Z, Angle=expr("x/2", angle.Angle))
vrot_2 = Rotate(Vector=vec_4, Axis=Z_3, Angle=expression_4)
vrot_3 = Rotate(Vector=vec_4, Axis=Z_2, Angle=expression_5)
p_n_c = PickNChoose(Pattern=expression_3, Stream0=vrot, Stream1=vrot_2, Stream2=vrot_3)

# ---- group: Case 6: F, F, Fr, Fr
int_10 = Integer("1")
mindex_5 = MemberIndex(Set=int_3, Member=int_10)  # -> Index, Count
item_5 = ListItem(List=explode_2.Segments, Index=mindex_5.Index, Wrap=True)
item_6 = ListItem(List=item_5, Index=0, Wrap=True)  # -> Item, Item1
xprod = CrossProduct(VectorA=item_6.Item1, VectorB=item_6.Item, Unitize=False)  # -> Vector, Length
ccx = CurveCurve(CurveA=item_6.Item, CurveB=item_6.Item1)  # -> Points, ParamsA, ParamsB
devec = DeconstructVector(Vector=xprod.Vector)  # -> XComponent, YComponent, ZComponent
expression_6 = Expression(x=devec.ZComponent, Expression="if((x = 1), 0, 1)")
int_11 = Integer("-1")
panel_2 = Panel("""pi/8
pi/8+pi/4""")
Z_4 = UnitZ(Factor=1)
Z_5 = UnitZ(Factor=1)
vec_5 = Vector(item_6.Item)
vec_6 = Vector(item_6.Item1)
mindex_6 = MemberIndex(Set=int_3, Member=int_11)  # -> Index, Count
vrot_4 = Rotate(Vector=vec_5, Axis=Z_4, Angle=panel_2)
vrot_5 = Rotate(Vector=vec_6, Axis=Z_5, Angle=panel_2)
item_7 = ListItem(List=explode_2.Segments, Index=mindex_6.Index, Wrap=True)
line = LineSDL(Start=ccx.Points, Direction=vrot_4, Length=1)
line_2 = LineSDL(Start=ccx.Points, Direction=vrot_5, Length=1)
llx = LineLine(Line1=item_7, Line2=line)  # -> ParamA, ParamB, PointA, PointB
llx_2 = LineLine(Line1=item_7, Line2=line_2)  # -> ParamA, ParamB, PointA, PointB
ln_2 = Line(StartPoint=ccx.Points, EndPoint=llx.PointA)
ln_3 = Line(StartPoint=ccx.Points, EndPoint=llx_2.PointA)
boundary = BoundarySurfaces(Edges=move_4.Geometry)
split = SplitWithBrep(Curve=ln_3, Brep=boundary)  # -> Curve, Points
end = EndPoints(Curve=item_6.Item)  # -> Start, End
item_8 = ListItem(List=split.Curve, Index=0, Wrap=True)
filter = StreamFilter(Gate=expression_6, Stream0=ln_2, Stream1=item_8)
item_9 = ListItem(List=item_7, Index=0, Wrap=True)  # -> Item, Item1
expression_7 = Expression(x=end.Start, y=ccx.Points, Expression="if((x=y), 1, 0)")
flip = FlipCurve(Curve=item_9.Item1)  # -> Curve, Flag
loft = Loft(Curves=flatten(filter), Options={Adjust=False, Closed=False, LoftEnds=0, LoftSimp=0, LoftType=0, Rebuild=10, Refit=0.01})
len = Length(Curve=filter)
split_2 = SplitWithBrep(Curve=[item_9.Item, flip.Curve], Brep=loft)  # -> Curve, Points
division = Division(A=len, B=spacing)  # -> flatten(Result)
item_10 = ListItem(List=split_2.Curve, Index=0, Wrap=True)  # -> Item, Item1
flip_2 = FlipCurve(Curve=item_6.Item)  # -> Curve, Flag
flip_3 = FlipCurve(Curve=item_6.Item1)  # -> Curve, Flag
round = Round(Number=division)  # -> Nearest, Floor, Ceiling
filter_2 = StreamFilter(Gate=expression_7, Stream0=[flip_2.Curve, item_6.Item1], Stream1=[flip_3.Curve, item_6.Item])
len_2 = Length(Curve=item_10.Item1)
len_3 = Length(Curve=item_10.Item)
sort_2 = SortList(Keys=round.Nearest)  # -> Keys, ValuesA
division_2 = Division(A=len_2, B=spacing)  # -> flatten(Result)
division_3 = Division(A=len_3, B=spacing)  # -> flatten(Result)
item_11 = ListItem(List=sort_2.Keys, Index=0, Wrap=True)
divide = DivideCurve(Curve=flatten(filter_2), Count=item_11, Kinks=False)  # -> Points, Tangents, Parameters
round_2 = Round(Number=division_2)  # -> Nearest, Floor, Ceiling
round_3 = Round(Number=division_3)  # -> Nearest, Floor, Ceiling
bang_2 = ExplodeTree(Data=divide.Points)  # -> Branch0, Branch1
divide_2 = DivideCurve(Curve=flatten(filter), Count=item_11, Kinks=False)  # -> Points, Tangents, Parameters
sort_3 = SortList(Keys=round_2.Nearest)  # -> Keys, ValuesA
sort_4 = SortList(Keys=round_3.Nearest)  # -> Keys, ValuesA
bang_3 = ExplodeTree(Data=divide_2.Points)  # -> Branch0, Branch1
ln_4 = Line(StartPoint=bang_3.Branch1, EndPoint=bang_2.Branch0)
ln_5 = Line(StartPoint=bang_3.Branch0, EndPoint=bang_2.Branch1)
item_12 = ListItem(List=sort_3.Keys, Index=0, Wrap=True)
item_13 = ListItem(List=sort_4.Keys, Index=0, Wrap=True)
divide_3 = DivideCurve(Curve=flatten(item_10.Item1), Count=item_12, Kinks=False)  # -> Points, Tangents, Parameters
ln_6 = Line(StartPoint=bang_3.Branch0, EndPoint=bang_3.Branch1)
divide_4 = DivideCurve(Curve=flatten(item_10.Item), Count=item_13, Kinks=False)  # -> Points, Tangents, Parameters
bang_4 = ExplodeTree(Data=divide_3.Points)  # -> Branch0, Branch1
bang_5 = ExplodeTree(Data=divide_4.Points)  # -> Branch0, Branch1
ln_7 = Line(StartPoint=bang_4.Branch0, EndPoint=bang_4.Branch1)
ln_8 = Line(StartPoint=bang_5.Branch0, EndPoint=bang_5.Branch1)
len_4 = Length(Curve=ln_7)
len_5 = Length(Curve=ln_8)
sort_5 = SortList(Keys=len_4)  # -> Keys, ValuesA
sort_6 = SortList(Keys=len_5)  # -> Keys, ValuesA
item_14 = ListItem(List=reverse(sort_5.Keys), Index=0, Wrap=True)
item_15 = ListItem(List=reverse(sort_6.Keys), Index=0, Wrap=True)
larger = LargerThan(FirstNumber=item_14, SecondNumber=item_15)  # -> LargerThan, OrEqualTo
filter_3 = StreamFilter(Gate=larger.LargerThan, Stream0=ln_7, Stream1=ln_8)
entwine_2 = Entwine(Branch00=[filter_3, ln_6], Branch01=[ln_4, ln_5], Branch03=filter, FlattenInputs=True)

# ---- group: Case 5: P, F, Fr, Fr
int_12 = Integer("1")
int_13 = Integer("0")
mindex_7 = MemberIndex(Set=int_3, Member=int_12)  # -> Index, Count
mindex_8 = MemberIndex(Set=int_3, Member=int_13)  # -> Index, Count
item_16 = ListItem(List=explode_2.Segments, Index=mindex_8.Index, Wrap=True)
item_17 = ListItem(List=explode_2.Segments, Index=mindex_7.Index, Wrap=True)
ccx_2 = CurveCurve(CurveA=item_17, CurveB=item_16)  # -> Points, ParamsA, ParamsB
end_2 = EndPoints(Curve=item_17)  # -> Start, End
expression_8 = Expression(x=end_2.Start, y=ccx_2.Points, Expression="if((x=y), 1, 0)")
flip_4 = FlipCurve(Curve=item_17)  # -> Curve, Flag
flip_5 = FlipCurve(Curve=item_16)  # -> Curve, Flag
expression_9 = Expression(Expression="pi/2 - atan(Sqrt(2))")
filter_4 = StreamFilter(Gate=expression_8, Stream0=[flip_4.Curve, item_16], Stream1=[item_17, flip_5.Curve])
item_18 = ListItem(List=filter_4, Index=0, Wrap=True)
neg_2 = Negative(Value=expression_9)
Z_6 = UnitZ(Factor=1)
end_3 = EndPoints(Curve=item_18)  # -> Start, End
vrot_6 = Rotate(Vector=item_18, Axis=Z_6, Angle=[expression_9, neg_2])
line_3 = LineSDL(Start=end_3.Start, Direction=vrot_6, Length="50")
boundary_2 = BoundarySurfaces(Edges=move_4.Geometry)
split_3 = SplitWithBrep(Curve=line_3, Brep=boundary_2)  # -> Curve, Points
item_19 = ListItem(List=split_3.Curve, Index=0, Wrap=True)
len_6 = Length(Curve=item_19)
sort_7 = SortList(Keys=flatten(len_6), ValuesA=flatten(item_19))  # -> Keys, ValuesA
item_20 = ListItem(List=sort_7.ValuesA, Index=0, Wrap=True)
end_4 = EndPoints(Curve=item_16)  # -> Start, End
end_5 = EndPoints(Curve=item_20)  # -> Start, End
end_6 = EndPoints(Curve=item_17)  # -> Start, End
len_7 = Length(Curve=item_20)
expression_10 = Expression(x=end_5.Start, y=end_4.Start, Expression="if((x=y), 0, 1)")
expression_11 = Expression(x=end_5.Start, y=end_6.Start, Expression="if((x=y), 0, 1)")
division_4 = Division(A=len_7, B=spacing)
flip_6 = FlipCurve(Curve=item_16)  # -> Curve, Flag
flip_7 = FlipCurve(Curve=item_17)  # -> Curve, Flag
filter_5 = StreamFilter(Gate=expression_10, Stream0=item_16, Stream1=flip_6.Curve)
filter_6 = StreamFilter(Gate=expression_11, Stream0=item_17, Stream1=flip_7.Curve)
divide_5 = DivideCurve(Curve=filter_5, Count=division_4, Kinks=False)  # -> Points, Tangents, Parameters
divide_6 = DivideCurve(Curve=item_20, Count=division_4, Kinks=False)  # -> Points, Tangents, Parameters
divide_7 = DivideCurve(Curve=filter_6, Count=division_4, Kinks=False)  # -> Points, Tangents, Parameters
ln_9 = Line(StartPoint=divide_6.Points, EndPoint=divide_5.Points)
ln_10 = Line(StartPoint=divide_7.Points, EndPoint=divide_6.Points)
item_21 = ListItem(List=reverse(ln_9), Index=0, Wrap=True)  # -> Item, Item1
item_22 = ListItem(List=reverse(ln_10), Index=0, Wrap=True)  # -> Item, Item1
end_7 = EndPoints(Curve=item_21.Item)  # -> Start, End
end_8 = EndPoints(Curve=item_21.Item1)  # -> Start, End
end_9 = EndPoints(Curve=item_22.Item)  # -> Start, End
end_10 = EndPoints(Curve=item_22.Item1)  # -> Start, End
vec2pt_2 = Vector2Pt(PointA=end_8.Start, PointB=end_7.Start, Unitize=False)  # -> Vector, Length
vec2pt_3 = Vector2Pt(PointA=end_10.Start, PointB=end_9.Start, Unitize=False)  # -> Vector, Length
arrlinear = LinearArray(Geometry=item_21.Item, Direction=vec2pt_2.Vector, Count="50")  # -> Geometry, Transform
arrlinear_2 = LinearArray(Geometry=item_22.Item, Direction=vec2pt_3.Vector, Count="50")  # -> Geometry, Transform
cull_i_4 = CullIndex(List=arrlinear.Geometry, Indices=0, Wrap=True)
boundary_3 = BoundarySurfaces(Edges=move_4.Geometry)
boundary_4 = BoundarySurfaces(Edges=move_4.Geometry)
cull_i_5 = CullIndex(List=arrlinear_2.Geometry, Indices=0, Wrap=True)
split_4 = SplitWithBreps(Curve=cull_i_4, Brep=boundary_3)  # -> Curve, Points
split_5 = SplitWithBreps(Curve=cull_i_5, Brep=boundary_4)  # -> Curve, Points
item_23 = ListItem(List=split_4.Curve, Index=0, Wrap=True)  # -> Item, Item1
item_24 = ListItem(List=split_5.Curve, Index=0, Wrap=True)  # -> Item, Item1
geo = Geometry(item_24.Item1)
geo_2 = Geometry(item_23.Item1)
entwine_3 = Entwine(Branch00=[ln_9, geo_2], Branch01=[ln_10, geo], Branch03=item_20, FlattenInputs=True)

# ---- group: Case 4: P, P, Fr, Fr
int_14 = Integer("-1")
int_15 = Integer("0")
mindex_9 = MemberIndex(Set=int_3, Member=int_14)  # -> Index, Count
mindex_10 = MemberIndex(Set=int_3, Member=int_15)  # -> Index, Count
item_25 = ListItem(List=explode_2.Segments, Index=mindex_9.Index, Wrap=True)
item_26 = ListItem(List=explode_2.Segments, Index=mindex_10.Index, Wrap=True)
len_8 = Length(Curve=item_25)
len_9 = Length(Curve=item_26)
division_5 = Division(A=len_8, B=spacing)
division_6 = Division(A=len_9, B=spacing)
round_4 = Round(Number=division_5)  # -> Nearest, Floor, Ceiling
round_5 = Round(Number=division_6)  # -> Nearest, Floor, Ceiling
item_27 = ListItem(List=item_25, Index=0, Wrap=True)  # -> Item, Item1
item_28 = ListItem(List=item_26, Index=0, Wrap=True)  # -> Item, Item1
sort_8 = SortList(Keys=round_4.Nearest)  # -> Keys, ValuesA
sort_9 = SortList(Keys=round_5.Nearest)  # -> Keys, ValuesA
flip_8 = FlipCurve(Curve=item_27.Item)  # -> Curve, Flag
item_29 = ListItem(List=sort_8.Keys, Index=0, Wrap=True)
flip_9 = FlipCurve(Curve=item_28.Item)  # -> Curve, Flag
item_30 = ListItem(List=sort_9.Keys, Index=0, Wrap=True)
divide_8 = DivideCurve(Curve=[flip_8.Curve, item_27.Item1], Count=item_29, Kinks=False)  # -> Points, Tangents, Parameters
divide_9 = DivideCurve(Curve=[flip_9.Curve, item_28.Item1], Count=item_30, Kinks=False)  # -> Points, Tangents, Parameters
bang_6 = ExplodeTree(Data=divide_8.Points)  # -> Branch0, Branch1
bang_7 = ExplodeTree(Data=divide_9.Points)  # -> Branch0, Branch1
ln_11 = Line(StartPoint=bang_6.Branch0, EndPoint=bang_6.Branch1)
ln_12 = Line(StartPoint=bang_7.Branch0, EndPoint=bang_7.Branch1)
merge_2 = Merge(Data1=ln_12, Data2=ln_11)
clean = CleanTree(RemoveNulls=True, RemoveInvalid=True, RemoveEmpty=False, Tree=merge_2)
entwine_4 = Entwine(Branch00=clean, FlattenInputs=True)

# ---- group: Case 2: Fr, F, Fr, F
int_16 = Integer("1")
int_17 = Integer("-1")
mindex_11 = MemberIndex(Set=int_3, Member=int_16)  # -> Index, Count
mindex_12 = MemberIndex(Set=int_3, Member=int_17)  # -> Index, Count
item_31 = ListItem(List=explode.Segments, Index=mindex_11.Index, Wrap=True)
item_32 = ListItem(List=explode_2.Segments, Index=mindex_12.Index, Wrap=True)
len_10 = Length(Curve=item_32)
panel_3 = Panel("""0.25
0.75""")
divdist_2 = DivideDistance(Curve=item_31, Distance=spacing)  # -> Points, Tangents, Parameters
multiplication = Multiplication(A=len_10, B=panel_3)
cull_i_6 = CullIndex(List=divdist_2.Points, Indices=0, Wrap=True)
eval = EvaluateCurve(Curve=graft(item_32), Parameter=multiplication)  # -> Point, Tangent, Angle
avr_2 = Average(Input=cull_i_6)  # -> simplify(ArithmeticMean)
midpt_2 = CurveMiddle(Curve=item_31)
bang_8 = ExplodeTree(Data=eval.Point)  # -> Branch0, Branch1
vec2pt_4 = Vector2Pt(PointA=avr_2, PointB=graft(midpt_2), Unitize=False)  # -> Vector, Length
rev = ReverseList(List=bang_8.Branch1)
move_6 = Move(Geometry=cull_i_6, Motion=vec2pt_4.Vector)  # -> Geometry, Transform
ln_13 = Line(StartPoint=bang_8.Branch0, EndPoint=rev)
loft_2 = Loft(Curves=ln_13, Options={Adjust=False, Closed=False, LoftEnds=0, LoftSimp=0, LoftType=0, Rebuild=10, Refit=0.01})
bang_9 = ExplodeTree(Data=move_6.Geometry)  # -> _0000, reverse(Branch1)
ln_14 = Line(StartPoint=bang_9._0000, EndPoint=bang_9.Branch1)
split_6 = SplitWithBrep(Curve=ln_14, Brep=loft_2)  # -> simplify(Curve), Points
item_33 = ListItem(List=split_6.Curve, Index=0, Wrap=True)  # -> Item, Item1, Item2
entwine_5 = Entwine(Branch00=item_33.Item1, Branch01=[item_33.Item, item_33.Item2], Branch02=ln_13, FlattenInputs=True)

# ----
expression_12 = Expression(x=merge, Expression="if(x=-1, 1, 0)")
ma_2 = MassAddition(Input=expression_12)  # -> Result, PartialResults
expression_13 = Expression(x=ma_2.Result, Expression="if(x>0, 1, 0)")
item_34 = ListItem(List=explode_2.Segments, Index=mindex_4.Index, Wrap=True)
geo_3 = Geometry(explode_2.Segments)
c_script = CSharpScript()  # -> out, flatten(A); inputs cu: Curve; disabled
# ---------- c_script: C# usings ----------
using System.IO;
using System.Linq;
using System.Data;
using System.Drawing;
using System.Reflection;
using System.Windows.Forms;
using System.Xml;
using System.Xml.Linq;
using System.Runtime.InteropServices;

using Rhino.DocObjects;
using Rhino.Collections;
using GH_IO;
using GH_IO.Serialization;
# ---------- c_script: C# ----------
    //var oa = new Rhino.DocObjects.ObjectAttributes();
    //oa.SetUserString("test", "value");
    var attributes = new ObjectAttributes();
    attributes.ObjectColor = Color.CadetBlue;
    attributes.ColorSource = ObjectColorSource.ColorFromObject;
    Rhino.DocObjects.Tables.ObjectTable ot = Rhino.RhinoDoc.ActiveDoc.Objects;
    ot.Add(cu, attributes);
    A = cu;

    //doc.Objects.AddCurve(cu, attributes);
    //doc.Views.Redraw();
# ---------- end c_script ----------
c_script_2 = CSharpScript()  # -> out, flatten(A); inputs cu: Curve; disabled
# ---------- c_script_2: C# ----------
    var attributes = new ObjectAttributes();
    attributes.ObjectColor = Color.CadetBlue;
    attributes.ColorSource = ObjectColorSource.ColorFromObject;
    doc.Objects.AddCurve(cu, attributes);
    doc.Views.Redraw();
# ---------- end c_script_2 ----------
c_script_3 = CSharpScript()  # -> out, flatten(A); inputs cu: Curve, co: Color; disabled
# ---------- c_script_3: C# ----------
    if (cu == null) return;
    if (co.A == 0) return;

    _curves.Add(cu);
    _colors.Add((co));
# ---------- c_script_3: C# additional code ----------
  private readonly List<Curve> _curves = new List<Curve>();
  private readonly List<System.Drawing.Color> _colors = new List<System.Drawing.Color>();
  public List<Line> A;
  private BoundingBox _box;

  /// <summary>
  /// This method will be called once every solution, before any calls to RunScript.
  /// </summary>
  public override void BeforeRunScript()
  {
    _box = BoundingBox.Empty;
    _curves.Clear();
    _colors.Clear();
  }

  public override BoundingBox ClippingBox
  {
    get { return _box; }
  }

  public override void DrawViewportWires(IGH_PreviewArgs args)
  {
    for (int i = 0; i < _curves.Count; i++)
      args.Display.DrawCurve(_curves[i], _colors[i]);
  }
# ---------- end c_script_3 ----------

# ---- group: Case 1: Fr, P, FR, F
int_18 = Integer("-1")
int_19 = Integer("0")
int_20 = Integer("1")
mindex_13 = MemberIndex(Set=int_3, Member=int_18)  # -> Index, Count
mindex_14 = MemberIndex(Set=int_3, Member=int_19)  # -> Index, Count
mindex_15 = MemberIndex(Set=int_3, Member=int_20)  # -> Index, Count
item_35 = ListItem(List=explode_2.Segments, Index=mindex_13.Index, Wrap=True)  # -> Item, Item1
item_36 = ListItem(List=explode.Segments, Index=mindex_15.Index, Wrap=True)
item_37 = ListItem(List=explode.Segments, Index=mindex_14.Index, Wrap=True)
item_38 = ListItem(List=item_35.Item, Index=0, Wrap=True)  # -> Item, Item1
divdist_3 = DivideDistance(Curve=item_36, Distance=spacing)  # -> Points, Tangents, Parameters
sqrt = SquareRoot(Value="2")
flip_10 = FlipCurve(Curve=item_38.Item)  # -> Curve, Flag
divdist_4 = DivideDistance(Curve=item_37, Distance=spacing)  # -> Points, Tangents, Parameters
cull_i_7 = CullIndex(List=divdist_3.Points, Indices=0, Wrap=True)
division_7 = Division(A="1", B=sqrt)
cull_i_8 = CullIndex(List=divdist_4.Points, Indices=0, Wrap=True)
midpt_3 = CurveMiddle(Curve=item_36)
avr_3 = Average(Input=cull_i_7)  # -> simplify(ArithmeticMean)
eval_2 = EvaluateCurve(Curve=reparameterize([flip_10.Curve, item_38.Item1]), Parameter=division_7)  # -> Point, Tangent, Angle
avr_4 = Average(Input=cull_i_8)  # -> simplify(ArithmeticMean)
midpt_4 = CurveMiddle(Curve=item_37)
item_39 = ListItem(List=eval_2.Point, Index=0, Wrap=True)  # -> Item, Item1
vec2pt_5 = Vector2Pt(PointA=avr_3, PointB=graft(midpt_3), Unitize=False)  # -> Vector, Length
vec2pt_6 = Vector2Pt(PointA=avr_4, PointB=graft(midpt_4), Unitize=False)  # -> Vector, Length
ln_15 = Line(StartPoint=item_39.Item, EndPoint=item_39.Item1)
move_7 = Move(Geometry=cull_i_7, Motion=vec2pt_5.Vector)  # -> Geometry, Transform
move_8 = Move(Geometry=cull_i_8, Motion=vec2pt_6.Vector)  # -> Geometry, Transform
flip_11 = FlipCurve(Curve=ln_15)  # -> Curve, Flag
divdist_5 = DivideDistance(Curve=[flip_11.Curve, ln_15], Distance=spacing)  # -> Points, Tangents, Parameters
cull_i_9 = CullIndex(List=divdist_5.Points, Indices=0, Wrap=True)
avr_5 = Average(Input=cull_i_9)  # -> simplify(ArithmeticMean)
midpt_5 = CurveMiddle(Curve=ln_15)
vec2pt_7 = Vector2Pt(PointA=avr_5, PointB=graft(midpt_5), Unitize=False)  # -> Vector, Length
move_9 = Move(Geometry=cull_i_9, Motion=vec2pt_7.Vector)  # -> Geometry, Transform
ln_16 = Line(StartPoint=move_9.Geometry, EndPoint=move_8.Geometry)
# Positive
# Negative
# Internal
# Edge
ln_17 = Line(StartPoint=move_9.Geometry, EndPoint=move_7.Geometry)

# ----
len_11 = Length(Curve=ln_16)
len_12 = Length(Curve=ln_17)
tstat = TreeStatistics(Tree=ln_16)  # -> Paths, Length, Count
tstat_2 = TreeStatistics(Tree=ln_17)  # -> Paths, Length, Count
ma_3 = MassAddition(Input=len_11)  # -> Result, PartialResults
ma_4 = MassAddition(Input=len_12)  # -> Result, PartialResults
sort_10 = SortList(Keys=flatten(ma_3.Result), ValuesA=tstat.Paths)  # -> Keys, ValuesA
sort_11 = SortList(Keys=flatten(ma_4.Result), ValuesA=tstat_2.Paths)  # -> Keys, ValuesA
item_40 = ListItem(List=sort_10.ValuesA, Index=0, Wrap=True)
item_41 = ListItem(List=sort_11.ValuesA, Index=0, Wrap=True)
branch = TreeBranch(Tree=ln_16, Path=item_40, MaintainPaths=True)
branch_2 = TreeBranch(Tree=ln_17, Path=item_41, MaintainPaths=True)

# ---- group: Case 1: Fr, P, FR, F (continued)
entwine_6 = Entwine(Branch00=branch, Branch01=branch_2, Branch02=ln_15, FlattenInputs=True)

# ---- group: Case 3: F, FR, FR, FR
int_21 = Integer("1")
mindex_16 = MemberIndex(Set=int_3, Member=int_21)  # -> Index, Count
item_42 = ListItem(List=explode_2.Segments, Index=mindex_16.Index, Wrap=True)  # -> Item, Item1, Item2
flip_12 = FlipCurve(Curve=item_42.Item2)  # -> Curve, Flag
divdist_6 = DivideDistance(Curve=[item_42.Item, flip_12.Curve], Distance=spacing)  # -> Points, Tangents, Parameters
bang_10 = ExplodeTree(Data=divdist_6.Points)  # -> Branch0, Branch1
ln_18 = Line(StartPoint=bang_10.Branch0, EndPoint=bang_10.Branch1)

# ----
cull_i_10 = CullIndex(List=ln_18, Indices=0, Wrap=True)
flip_13 = FlipCurve(Curve=cull_i_10)  # -> Curve, Flag

# ---- group: Case 3: F, FR, FR, FR (continued)
entwine_7 = Entwine(Branch01=flip_13.Curve, FlattenInputs=True)

# ----
filter_7 = StreamFilter(
    Gate=expression,
    Stream0=entwine,
    Stream1=entwine_6,
    Stream2=entwine_5,
    Stream3=entwine_7,
    Stream4=entwine_4,
    Stream5=entwine_3,
    Stream6=entwine_2)
bang_11 = ExplodeTree(Data=filter_7)  # -> Branch0, Branch1, Branch2, Branch3

# ----
# Boundary Fixities
number_slider = Slider(0, range=0..1)

int_22 = Integer(number_slider)
int_23 = Integer(Slider(1, range=0..1))
int_24 = Integer(Slider(-1, range=-2..1))

mindex_17 = MemberIndex(Set=int_7, Member=int_22)  # -> Index, Count
mindex_18 = MemberIndex(Set=int_8, Member=int_23)  # -> Index, Count
mindex_19 = MemberIndex(Set=int_9, Member=int_24)  # -> Index, Count
item_43 = ListItem(List=explode_2.Segments, Index=mindex_17.Index, Wrap=True)
item_44 = ListItem(List=explode_2.Segments, Index=mindex_19.Index, Wrap=True)
item_45 = ListItem(List=explode_2.Segments, Index=mindex_18.Index, Wrap=True)
preview = CustomPreview(Geometry=item_43, Material=ColourSwatch(SwatchColor=RGB(0, 0, 0)))
preview_2 = CustomPreview(Geometry=item_45, Material=ColourSwatch(SwatchColor=RGB(0, 217, 250)))
preview_3 = CustomPreview(Geometry=item_44, Material=ColourSwatch(SwatchColor=RGB(21, 255, 0)))

c_script_4 = CSharpScript(geom=item_43, key="myName", value="pinned")  # -> out, A; inputs geom: list of Curve, key: String, value: String
# ---------- c_script_4: C# ----------
    for (int i = 0; i < geom.Count; i++){
      geom[i].SetUserString(_key, _value);
      A = geom;
    }
# ---------- end c_script_4 ----------
c_script_5 = CSharpScript(geom=item_45, key="myName", value="fixed")  # -> out, A; inputs geom: list of Curve, key: String, value: String; same code as c_script_4
c_script_6 = CSharpScript(geom=item_44, key="myName", value="free")  # -> out, A; inputs geom: list of Curve, key: String, value: String; same code as c_script_4

# ---- group: RH_OUT:pinned
crv = Curve(c_script_4.A)

# ---- group: RH_OUT:fixed
crv_2 = Curve(c_script_5.A)

# ---- group: RH_OUT:free
crv_3 = Curve(c_script_6.A)

# ----
line_4 = LineSDL(Start=cull_i_3, Direction=p_n_c, Length=1)
shift_5 = ShiftList(List=line_4, Shift=1, Wrap=True)
llx_3 = LineLine(Line1=line_4, Line2=shift_5)  # -> ParamA, ParamB, PointA, PointB
ln_19 = Line(StartPoint=llx_3.PointA, EndPoint=cull_i_3)
shift_6 = ShiftList(List=ln_19, Shift=1, Wrap=True)
ccx_3 = CurveCurve(CurveA=ln_19, CurveB=shift_6)  # -> Points, ParamsA, ParamsB

# ----
# Junction Center
ccx_4 = CurveCurve(CurveA=ln_19, CurveB=shift_6)  # -> flatten(Points), ParamsA, ParamsB

duppt = RemoveDuplicatePts(Points=ccx_4.Points, Tolerance=0.01)
unflatten = UnflattenTree(Tree=duppt, Guide=ccx_3.Points)
prune = PruneTree(Tree=unflatten, Minimum=1, Maximum=0)

filter_8 = StreamFilter(Gate=expression_13, Stream0=prune, Stream1=llx_3.PointA)
null = NullItem(Item=filter_8)  # -> NullFlags, InvalidFlags, Description
not = GateNot(A=null.NullFlags)
cull = CullPattern(List=filter_8, CullPattern=not)
crv_cp = CurveClosestPoint(Point=cull, Curve=explode_2.Segments)  # -> Point, Parameter, Distance
ln_20 = Line(StartPoint=cull, EndPoint=crv_cp.Point)
prune_2 = PruneTree(Tree=ln_20, Minimum=1, Maximum=0)
vec_7 = Vector(prune_2)
null_2 = NullItem(Item=vec_7)  # -> NullFlags, InvalidFlags, Description
not_2 = GateNot(A=null_2.NullFlags)
cull_2 = CullPattern(List=vec_7, CullPattern=not_2)
multiplication_2 = Multiplication(A=cull_2, B="0.5")
len_13 = Length(Curve=prune_2)
null_3 = NullItem(Item=len_13)  # -> NullFlags, InvalidFlags, Description
not_3 = GateNot(A=null_3.NullFlags)
move_10 = Move(Geometry=cull, Motion=cull_2)  # -> Geometry, Transform
move_11 = Move(Geometry=cull, Motion=multiplication_2)  # -> Geometry, Transform
cull_3 = CullPattern(List=len_13, CullPattern=not_3)  # -> flatten(List)
unflatten_2 = UnflattenTree(Tree=cull_3, Guide=prune_2)

# ----
# Line Lengths
expression_14 = Expression(x=int_3, y=unflatten_2, Expression="if(x=0,y*sqrt(2), if(x=1, y, z)) ")

cset = CreateSet(List=expression_14)  # -> Set, Map
mindex_20 = MemberIndex(Set=expression_14, Member=cset.Set)  # -> Index, Count
lng = ListLength(List=mindex_20.Index)

# ----
# Associated support indexes
expression_15 = Expression(x=lng, y=mindex_20.Index, Expression="if(x≥3, y, \"error\")")
prune_3 = PruneTree(Tree=expression_15, Minimum=2, Maximum=0)  # -> simplify(Tree)

tstat_3 = TreeStatistics(Tree=prune_3)  # -> Paths, Length, Count
shift_7 = ShiftList(List=tstat_3.Paths, Shift=1, Wrap=True)
shift_8 = ShiftList(List=prune_3, Shift=1, Wrap=True)
branch_3 = TreeBranch(Tree=prune_3, Path=flatten(tstat_3.Paths), MaintainPaths=True)
branch_4 = TreeBranch(Tree=prune_3, Path=shift_7, MaintainPaths=False)
intersection = SetIntersection(SetA=branch_3, SetB=branch_4)
item_46 = ListItem(List=geo_3, Index=prune_3, Wrap=True)
item_47 = ListItem(List=geo_3, Index=shift_8, Wrap=True)
llx_4 = LineLine(Line1=item_46, Line2=item_47)  # -> ParamA, ParamB, PointA, PointB

# ----
# Junction Vertices
expression_16 = Expression(x=int_3, y=move_10.Geometry, z=move_11.Geometry, u=move_11.Geometry, Expression="if(x=0, y, if(x=1, z, u))")

null_4 = NullItem(Item=expression_16)  # -> NullFlags, InvalidFlags, Description
not_4 = GateNot(A=null_4.NullFlags)
cull_4 = CullPattern(List=expression_16, CullPattern=not_4)
prune_4 = PruneTree(Tree=cull_4, Minimum=1, Maximum=0)  # -> flatten(Tree)
unflatten_3 = UnflattenTree(Tree=prune_4, Guide=expression_16)

item_48 = ListItem(List=unflatten_3, Index=prune_3, Wrap=True)

shift_9 = ShiftList(List=item_48, Shift=1, Wrap=True)

# ----
# Junction Center Lines
ln_21 = Line(StartPoint=item_48, EndPoint=shift_9)

preview_4 = CustomPreview(Geometry=ln_21, Material=ColourSwatch(SwatchColor=RGB(255, 15, 243)))
crv_cp_2 = CurveClosestPoint(Point=item_48, Curve=item_34)  # -> Point, Parameter, Distance
ln_22 = Line(StartPoint=item_48, EndPoint=crv_cp_2.Point)
sort_12 = SortList(Keys=ln_22)  # -> Keys, ValuesA
item_49 = ListItem(List=unflatten_3, Index=shift_8, Wrap=True)
item_50 = ListItem(List=unflatten_3, Index=prune_3, Wrap=True)
item_51 = ListItem(List=sort_12.Keys, Index=-1, Wrap=True)
len_14 = Length(Curve=ln_22)
item_52 = ListItem(List=unflatten_3, Index=intersection, Wrap=True)
mindex_21 = MemberIndex(Set=len_14, Member=item_51)  # -> Index, Count
bang_12 = ExplodeTree(Data=item_52)  # -> Branch0, Branch1
ln_23 = Line(StartPoint=llx_4.PointA, EndPoint=item_50)  # -> flatten(Line)
ln_24 = Line(StartPoint=llx_4.PointA, EndPoint=item_49)  # -> flatten(Line)
null_5 = NullItem(Item=ln_23)  # -> NullFlags, InvalidFlags, Description
null_6 = NullItem(Item=ln_24)  # -> NullFlags, InvalidFlags, Description

# ----
# Internal branches
ln_25 = Line(StartPoint=bang_12.Branch0, EndPoint=bang_12.Branch1)

not_5 = GateNot(A=null_5.NullFlags)
not_6 = GateNot(A=null_6.NullFlags)
internal_branches = Relay([ln_25, bang_11.Branch2])
preview_5 = CustomPreview(Geometry=ln_25, Material=ColourSwatch(SwatchColor=RGB(255, 238, 0)))

# ----
# edge branches
cull_i_11 = CullIndex(List=ln_22, Indices=mindex_21.Index, Wrap=True)  # -> flatten(List)
cull_5 = CullPattern(List=ln_24, CullPattern=not_6)
cull_6 = CullPattern(List=ln_23, CullPattern=not_5)

clean_2 = CleanTree(RemoveNulls=True, RemoveInvalid=True, RemoveEmpty=False, Tree=[cull_6, cull_5, cull_i_11])
edge_branches = Relay([clean_2, bang_11.Branch3])
preview_6 = CustomPreview(Geometry=[cull_i_11, cull_5, cull_6], Material=ColourSwatch(SwatchColor=RGB(255, 170, 0)))
c_script_7 = CSharpScript(geom=edge_branches, key="myName", value="edge")  # -> out, A; inputs geom: list of Curve, key: String, value: String; same code as c_script_4
c_script_8 = CSharpScript(geom=internal_branches, key="myName", value="internal")  # -> out, A; inputs geom: list of Curve, key: String, value: String; same code as c_script_4
c_script_9 = CSharpScript(geom=ln_21, key="myName", value="junction")  # -> out, A; inputs geom: list of Curve, key: String, value: String; same code as c_script_4

divdist_7 = DivideDistance(Curve=ln_25, Distance=spacing)  # -> Points, Tangents, Parameters
cull_i_12 = CullIndex(List=divdist_7.Points, Indices=0, Wrap=True)
avr_6 = Average(Input=cull_i_12)  # -> simplify(ArithmeticMean)
midpt_6 = CurveMiddle(Curve=ln_25)
vec2pt_8 = Vector2Pt(PointA=avr_6, PointB=graft(midpt_6), Unitize=False)  # -> Vector, Length
bang_13 = ExplodeTree(Data=intersection)  # -> Branch0, Branch1
move_12 = Move(Geometry=cull_i_12, Motion=vec2pt_8.Vector)  # -> Geometry, Transform
item_53 = ListItem(List=geo_3, Index=bang_13.Branch0, Wrap=True)
Z_7 = UnitZ(Factor=1)
vec_8 = Vector(item_53)
vrot_7 = Rotate(Vector=vec_8, Axis=Z_7, Angle=-1.570796327)
line_5 = LineSDL(Start=move_12.Geometry, Direction=graft(vrot_7), Length=1)
llx_5 = LineLine(Line1=line_5, Line2=graft(item_53))  # -> ParamA, ParamB, PointA, PointB
ln_26 = Line(StartPoint=llx_5.PointA, EndPoint=move_12.Geometry)
flip_14 = FlipCurve(Curve=ln_26)  # -> Curve, Flag
preview_7 = CustomPreview(Geometry=flip_14.Curve, Material=ColourSwatch(SwatchColor=RGB(0, 225, 255)))

end_11 = EndPoints(Curve=cull_6)  # -> Start, End
end_12 = EndPoints(Curve=cull_5)  # -> Start, End
ln_27 = Line(StartPoint=end_11.End, EndPoint=end_11.Start)
ln_28 = Line(StartPoint=end_12.End, EndPoint=end_12.Start)
end_13 = EndPoints(Curve=ln_28)  # -> Start, End
end_14 = EndPoints(Curve=ln_27)  # -> Start, End
vec2pt_9 = Vector2Pt(PointA=end_14.Start, PointB=end_13.Start, Unitize=False)  # -> Vector, Length
divdist_8 = DivideDistance(Curve=ln_27, Distance=spacing)  # -> Points, Tangents, Parameters
line_6 = LineSDL(Start=divdist_8.Points, Direction=graft(vec2pt_9.Vector), Length=1)
llx_6 = LineLine(Line1=line_6, Line2=graft(ln_28))  # -> ParamA, ParamB, PointA, PointB
ln_29 = Line(StartPoint=divdist_8.Points, EndPoint=llx_6.PointA)
cull_i_13 = CullIndex(List=ln_29, Indices=0, Wrap=True)
preview_8 = CustomPreview(Geometry=cull_i_13, Material=ColourSwatch(SwatchColor=RGB(0, 0, 0)))

# ---- group: RH_OUT:edge
crv_4 = Curve(c_script_7.A)

# ---- group: RH_OUT:internal
crv_5 = Curve(c_script_8.A)

# ---- group: RH_OUT:junction
crv_6 = Curve(c_script_9.A)

# ----
bang_14 = ExplodeTree(Data=move_12.Geometry)  # -> Branch0, Branch1
ln_30 = Line(StartPoint=bang_14.Branch0, EndPoint=bang_14.Branch1)
preview_9 = CustomPreview(Geometry=ln_30, Material=ColourSwatch(SwatchColor=RGB(93, 0, 255)))

null_7 = NullItem(Item=llx_4.PointA)  # -> NullFlags, InvalidFlags, Description
shift_10 = ShiftList(List=prune_3, Shift=1, Wrap=True)
not_7 = GateNot(A=null_7.NullFlags)
cull_7 = CullPattern(List=shift_10, CullPattern=not_7)
item_54 = ListItem(List=geo_3, Index=cull_7, Wrap=True)
Z_8 = UnitZ(Factor=1)
vec_9 = Vector(item_54)
vrot_8 = Rotate(Vector=vec_9, Axis=Z_8, Angle=-1.570796327)  # -> graft(Vector)
line_7 = LineSDL(Start=llx_6.PointA, Direction=vrot_8, Length=1)
llx_7 = LineLine(Line1=line_7, Line2=graft(item_54))  # -> ParamA, ParamB, PointA, PointB
ln_31 = Line(StartPoint=llx_6.PointA, EndPoint=llx_7.PointA)
preview_10 = CustomPreview(Geometry=ln_31, Material=ColourSwatch(SwatchColor=RGB(255, 0, 0)))

null_8 = NullItem(Item=llx_4.PointA)  # -> NullFlags, InvalidFlags, Description
not_8 = GateNot(A=null_8.NullFlags)
cull_8 = CullPattern(List=prune_3, CullPattern=not_8)
item_55 = ListItem(List=geo_3, Index=cull_8, Wrap=True)
Z_9 = UnitZ(Factor=1)
vec_10 = Vector(item_55)
vrot_9 = Rotate(Vector=vec_10, Axis=Z_9, Angle=-1.570796327)  # -> graft(Vector)
line_8 = LineSDL(Start=divdist_8.Points, Direction=vrot_9, Length=1)
llx_8 = LineLine(Line1=line_8, Line2=graft(item_55))  # -> ParamA, ParamB, PointA, PointB
ln_32 = Line(StartPoint=divdist_8.Points, EndPoint=llx_8.PointA)
preview_11 = CustomPreview(Geometry=ln_32, Material=ColourSwatch(SwatchColor=RGB(255, 0, 0)))

item_56 = ListItem(List=cull_i_11, Index=-1, Wrap=True)
item_57 = ListItem(List=cull_i_11, Index=0, Wrap=True)
divdist_9 = DivideDistance(Curve=[item_57, item_56], Distance=spacing)  # -> Points, Tangents, Parameters
mindex_22 = MemberIndex(Set=int_3, Member=-1)  # -> Index, Count
Z_10 = UnitZ(Factor=1)
subtraction_2 = Subtraction(A=mindex_22.Index, B=1)
addition_3 = Addition(A=mindex_22.Index, B=1)
item_58 = ListItem(List=geo_3, Index=[subtraction_2, addition_3], Wrap=True)
vec_11 = Vector(item_58)
vrot_10 = Rotate(Vector=vec_11, Axis=Z_10, Angle=1.570796327)
line_9 = LineSDL(Start=divdist_9.Points, Direction=graft(vrot_10), Length=1)
llx_9 = LineLine(Line1=line_9, Line2=graft(item_58))  # -> ParamA, ParamB, PointA, PointB
ln_33 = Line(StartPoint=llx_9.PointA, EndPoint=divdist_9.Points)

cull_i_14 = CullIndex(List=ln_33, Indices=0, Wrap=True)
flip_15 = FlipCurve(Curve=cull_i_14)  # -> Curve, Flag
negative = Relay([ln_32, ln_31, flip_14.Curve, bang_11.Branch1, flip_15.Curve])
clean_3 = CleanTree(RemoveNulls=True, RemoveInvalid=True, RemoveEmpty=False, Tree=flatten(negative))
flip_16 = FlipCurve(Curve=clean_3)  # -> Curve, Flag
dash = DashPattern(Curve=flip_16.Curve, Pattern=[Slider(0.5, range=0..1), Slider(0.25, range=0..1)])  # -> Dashes, Gaps
c_script_10 = CSharpScript(geom=dash.Dashes, key="myName", value="negative")  # -> out, A; inputs geom: list of Curve, key: String, value: String; same code as c_script_4

# ---- group: RH_OUT:negative
crv_7 = Curve(c_script_10.A)

# ----
preview_12 = CustomPreview(Geometry=flip_15.Curve, Material=ColourSwatch(SwatchColor=RGB(255, 178, 0)))

bang_15 = ExplodeTree(Data=divdist_9.Points)  # -> Branch0, Branch1
ln_34 = Line(StartPoint=bang_15.Branch0, EndPoint=bang_15.Branch1)

cull_i_15 = CullIndex(List=ln_34, Indices=0, Wrap=True)
positive = Relay([cull_i_13, cull_i_15, ln_30, bang_11.Branch0])
clean_4 = CleanTree(RemoveNulls=True, RemoveInvalid=True, RemoveEmpty=False, Tree=flatten(positive))
c_script_11 = CSharpScript(geom=clean_4, key="myName", value="positive")  # -> out, A; inputs geom: list of Curve, key: String, value: String; same code as c_script_4

# ---- group: RH_OUT:positive
crv_8 = Curve(c_script_11.A)

# ----
preview_13 = CustomPreview(Geometry=cull_i_15, Material=ColourSwatch(SwatchColor=RGB(153, 255, 0)))
